# Grasshopper definition CAO.gh (Grasshopper 0.9.76)

# ---- group: Paramètres pièce rectangulaire
# Vis M6
distance_du_trou_de_fixation_aux_sommets = Slider(20, range=0..20)  # "Distance du trou de fixation aux sommets du rectangle"
number_slider = Slider(150, range=0..1000)
number_slider_2 = Slider(100, range=0..1000)
rayon_vis_fixation = Slider(3, range=0..10)

# ---- group: Paramètres fixation porte-outil
# Vis M6
rayon_vis_centrales = Slider(3, range=0..20)
rayon_position_trous_centraux = Slider(20, range=0..200)
rayon_écrou = Slider(5.525, range=0..10)

surplus = Slider(1, range=0..10)

# ---- group: Paramètres pièce circulaire
offset_fixation_externes = Slider(5, range=0..100)
rayon_arcs_externes = Slider(50, range=0..1000)
contour_fixation_externes = Slider(2.5, range=0..10)
rayon_vis_externes = Slider(2.5, range=0..10)
rayon_pièce = Slider(60, range=0..200)

# ---- group: Paramètres fixation equerres
# Vis M5
ecartement_des_nervures = Slider(40, range=0..50)
longueur_nervure = Slider(30, range=0..50)
distance_nervure_centre = Slider(10, range=0..50)
rayon_des_mervures = Slider(2.5, range=0..100)
rayon_tête_de_vis = Slider(4.25, range=0..10)

surplus_2 = Slider(1, range=0..5)

# ----
addition = Addition(A=rayon_écrou, B=surplus)
addition_2 = Addition(A=rayon_tête_de_vis, B=surplus_2)

division = Division(A=ecartement_des_nervures, B=2)
multiplication = Multiplication(A=division, B=2)
division_2 = Division(A=number_slider, B=2)
multiplication_2 = Multiplication(A=distance_nervure_centre, B=-1)
division_3 = Division(A=multiplication, B=2)
division_4 = Division(A=number_slider_2, B=2)
addition_3 = Addition(A=division_2, B=multiplication_2)
addition_4 = Addition(A=division_3, B=division_4)
subtraction = Subtraction(A=addition_3, B=longueur_nervure)
Y = UnitY(Factor=addition_4)
X = UnitX(Factor=addition_3)
X_2 = UnitX(Factor=subtraction)
Y_2 = UnitY(Factor=addition_4)
addition_5 = Addition(A=X, B=Y)
addition_6 = Addition(A=X_2, B=Y_2)
Y_3 = UnitY(Factor=1)
multiplication_3 = Multiplication(A=graft([rayon_des_mervures, addition_2]), B=-1)
multiplication_4 = Multiplication(A=Y_3, B=graft([rayon_des_mervures, addition_2]))
multiplication_5 = Multiplication(A=Y_3, B=multiplication_3)
move = Move(Geometry=[addition_6, addition_5], Motion=multiplication_4)  # -> Geometry, Transform
number_slider_3 = Slider(1, range=0..1)
move_2 = Move(Geometry=[addition_6, addition_5], Motion=multiplication_5)  # -> Geometry, Transform
split = SplitList(List=move.Geometry, Index=number_slider_3)  # -> ListA, ListB
split_2 = SplitList(List=move_2.Geometry, Index=number_slider_3)  # -> ListA, ListB
X_3 = UnitX(Factor=1)
ln = Line(StartPoint=split.ListA, EndPoint=split.ListB)
multiplication_6 = Multiplication(A=X_3, B=-1)
ln_2 = Line(StartPoint=split_2.ListA, EndPoint=split_2.ListB)
arc = ArcSED(Start=split.ListA, End=split_2.ListA, Direction=multiplication_6)  # -> Arc, Plane, Radius
arc_2 = ArcSED(Start=split.ListB, End=split_2.ListB, Direction=X_3)  # -> Arc, Plane, Radius
division_5 = Division(A=number_slider_2, B=2)
division_6 = Division(A=number_slider, B=2)
Y_4 = UnitY(Factor=division_5)
X_4 = UnitX(Factor=division_6)
yz = YZPlane(Origin=Point(0, 0, 0))
crv = Curve([arc_2.Arc, arc.Arc, ln, ln_2])
addition_7 = Addition(A=Y_4, B=X_4)
rotate = Rotate(Geometry=yz, Angle=1.570796327, Plane=PlaneXY(0, 0, 0))  # -> Geometry, Transform
pl_origin = PlaneOrigin(Base=rotate.Geometry, Origin=Y_4)
mirror = Mirror(Geometry=crv, Plane=pl_origin)  # -> Geometry, Transform
pl_origin_2 = PlaneOrigin(Base=yz, Origin=addition_7)
crv_2 = Curve([mirror.Geometry, crv])
mirror_2 = Mirror(Geometry=crv_2, Plane=pl_origin_2)  # -> Geometry, Transform

cir = Circle(Plane=PlaneXY(0, 0, 0), Radius=rayon_pièce)
crv_3 = Curve(cir)
addition_8 = Addition(A=rayon_pièce, B=offset_fixation_externes)
cir_2 = Circle(Plane=PlaneXY(0, 0, 0), Radius=addition_8)
divide = DivideCurve(Curve=cir_2, Count=Slider(4, range=0..4), Kinks=False)  # -> Points, Tangents, Parameters
cir_3 = Circle(Plane=divide.Points, Radius=rayon_vis_externes)
addition_9 = Addition(A=contour_fixation_externes, B=rayon_vis_externes)
cir_4 = Circle(Plane=divide.Points, Radius=addition_9)
tarc = TangentArcs(CircleA=cir_4, CircleB=crv_3, Radius=rayon_arcs_externes)  # -> ArcA, ArcB
mcx = MultipleCurves(Curves=[tarc.ArcA, tarc.ArcB, cir_4])  # -> Points, IndexA, IndexB, ParamA, ParamB
ccx = CurveCurve(CurveA=[tarc.ArcA, tarc.ArcB], CurveB=crv_3)  # -> flatten(Points), ParamsA, ParamsB
split_3 = SplitList(List=mcx.Points, Index=Slider(4, range=0..10))  # -> ListA, ListB
split_4 = SplitList(List=ccx.Points, Index=Slider(4, range=0..10))  # -> ListA, ListB
vec2pt = Vector2Pt(PointA=divide.Points, PointB=split_3.ListB, Unitize=False)  # -> Vector, Length
pl_3pt = Plane3Pt(PointA=divide.Points, PointB=split_3.ListA, PointC=split_3.ListB)
deplane = DeconstructPlane(Plane=pl_3pt)  # -> Origin, XAxis, YAxis, ZAxis
shift = ShiftList(List=split_4.ListB, Shift=Slider(1, range=0..1), Wrap=True)
angle = Angle(VectorA=deplane.XAxis, VectorB=vec2pt.Vector)  # -> Angle, Reflex
arc_3 = Arc(Plane=pl_3pt, Radius=vec2pt.Length, Angle=angle.Angle)  # -> Arc, Length
xy = XYPlane(Origin=Point(0, 0, 0))
pl_3pt_2 = Plane3Pt(PointA=xy, PointB=shift, PointC=split_4.ListA)
vec2pt_2 = Vector2Pt(PointA=xy, PointB=split_4.ListA, Unitize=False)  # -> Vector, Length
deplane_2 = DeconstructPlane(Plane=pl_3pt_2)  # -> Origin, XAxis, YAxis, ZAxis
angle_2 = Angle(VectorA=deplane_2.XAxis, VectorB=vec2pt_2.Vector)  # -> Angle, Reflex
arc_4 = Arc(Plane=pl_3pt_2, Radius=vec2pt_2.Length, Angle=angle_2.Angle)  # -> Arc, Length

cir_5 = Circle(Plane=PlaneXY(0, 0, 0), Radius=rayon_position_trous_centraux)
divide_2 = DivideCurve(Curve=cir_5, Count=Slider(4, range=0..4), Kinks=False)  # -> Points, Tangents, Parameters
cir_6 = Circle(Plane=divide_2.Points, Radius=graft([rayon_vis_centrales, addition]))

division_7 = Division(A=ecartement_des_nervures, B=2)
division_8 = Division(A=division_7, B=rayon_pièce)
yz_2 = YZPlane(Origin=Point(0, 0, 0))
atan = ArcTangent(Value=division_8)
rotate_2 = Rotate(Geometry=yz_2, Angle=Slider(3.927, range=0..6.283), Plane=PlaneXY(0, 0, 0))  # -> Geometry, Transform
deplane_3 = DeconstructPlane(Plane=rotate_2.Geometry)  # -> Origin, XAxis, YAxis, ZAxis
addition_10 = Addition(A=atan, B=Slider(0.785, range=0..6.283))
multiplication_7 = Multiplication(A=longueur_nervure, B=-1)
multiplication_8 = Multiplication(A=multiplication_7, B=deplane_3.ZAxis)
cos = Cosine(Value=addition_10)
sin = Sine(Value=addition_10)
multiplication_9 = Multiplication(A=sin, B=rayon_pièce)
multiplication_10 = Multiplication(A=cos, B=rayon_pièce)
pt = ConstructPoint(XCoordinate=multiplication_10, YCoordinate=multiplication_9, ZCoordinate=0)
cp = PlaneClosestPoint(Point=pt, Plane=rotate_2.Geometry)  # -> Point, UVPoint, Distance
dist = Distance(PointA=pt, PointB=cp.Point)
subtraction_2 = Subtraction(A=dist, B=distance_nervure_centre)
multiplication_11 = Multiplication(A=subtraction_2, B=-1)
multiplication_12 = Multiplication(A=deplane_3.ZAxis, B=multiplication_11)
subtraction_3 = Subtraction(A=pt, B=multiplication_12)
addition_11 = Addition(A=subtraction_3, B=multiplication_8)
multiplication_13 = Multiplication(A=graft([addition_2, rayon_des_mervures]), B=-1)
multiplication_14 = Multiplication(A=deplane_3.XAxis, B=graft([addition_2, rayon_des_mervures]))
multiplication_15 = Multiplication(A=deplane_3.XAxis, B=multiplication_13)
number_slider_4 = Slider(1, range=0..1)
move_3 = Move(Geometry=[addition_11, subtraction_3], Motion=multiplication_14)  # -> Geometry, Transform
move_4 = Move(Geometry=[addition_11, subtraction_3], Motion=multiplication_15)  # -> Geometry, Transform
split_5 = SplitList(List=move_3.Geometry, Index=number_slider_4)  # -> ListA, ListB
split_6 = SplitList(List=move_4.Geometry, Index=number_slider_4)  # -> ListA, ListB
ln_3 = Line(StartPoint=split_5.ListA, EndPoint=split_5.ListB)
ln_4 = Line(StartPoint=split_6.ListA, EndPoint=split_6.ListB)
multiplication_16 = Multiplication(A=deplane_3.ZAxis, B=-1)
arc_5 = ArcSED(Start=split_5.ListA, End=split_6.ListA, Direction=multiplication_16)  # -> Arc, Plane, Radius
arc_6 = ArcSED(Start=split_5.ListB, End=split_6.ListB, Direction=deplane_3.ZAxis)  # -> Arc, Plane, Radius
crv_4 = Curve([ln_3, ln_4, arc_6.Arc, arc_5.Arc])
xy_2 = XYPlane(Origin=Point(0, 0, 0))
prot = RotatePlane(Plane=xy_2, Angle=Slider(3.141, range=0..10))
orient = Orient(Geometry=crv_4, Source=PlaneXY(0, 0, 0), Target=prot)  # -> Geometry, Transform
crv_5 = Curve([orient.Geometry, crv_4])
yz_3 = YZPlane(Origin=Point(0, 0, 0))
rotate_3 = Rotate(Geometry=yz_3, Angle=Slider(2.356, range=0..6.283), Plane=PlaneXY(0, 0, 0))  # -> Geometry, Transform
mirror_3 = Mirror(Geometry=crv_5, Plane=rotate_3.Geometry)  # -> Geometry, Transform

trous_porte_outil = Curve(cir_6)

division_9 = Division(A=distance_du_trou_de_fixation_aux_sommets, B=2)
subtraction_4 = Subtraction(A=[number_slider, number_slider_2], B=distance_du_trou_de_fixation_aux_sommets)
X_5 = UnitX(Factor=division_9)
Y_5 = UnitY(Factor=division_9)
rectangle = Rectangle(Plane=PlaneXY(0, 0, 0), XSize=number_slider, YSize=number_slider_2, Radius=0)  # -> Rectangle, Length
split_7 = SplitList(List=subtraction_4, Index=Slider(1, range=0..1))  # -> ListA, ListB
rectangle_2 = Rectangle(Plane=PlaneXY(0, 0, 0), XSize=split_7.ListA, YSize=split_7.ListB, Radius=0)  # -> Rectangle, Length
addition_12 = Addition(A=X_5, B=Y_5)
xy_3 = XYPlane(Origin=Point(0, 0, 0))
pl_origin_3 = PlaneOrigin(Base=xy_3, Origin=addition_12)
orient_2 = Orient(Geometry=rectangle_2.Rectangle, Source=PlaneXY(0, 0, 0), Target=pl_origin_3)  # -> Geometry, Transform
brep = Brep(orient_2.Geometry)
debrep = DeconstructBrep(Brep=brep)  # -> Faces, Edges, Vertices
cir_7 = Circle(Plane=debrep.Vertices, Radius=rayon_vis_fixation)

base_table = Curve([rectangle.Rectangle, cir_7])
base = Curve([arc_4.Arc, arc_3.Arc, tarc.ArcA, tarc.ArcB, cir_3])
nervures = Curve([mirror_3.Geometry, crv_5])
crv_6 = Curve([mirror_2.Geometry, crv_2])
