# Grasshopper definition SensorEmulator.gh (Grasshopper 0.9.76)
# plug-ins: Firefly.X

udp_listener = UDPListener(Port=Slider(2000, range=0..10000))
toggle = BooleanToggle(True)
timer = Timer(TimerInterval=20, Target=[udp_listener, c_script_2, udp_sender])
panel = Panel(udp_listener)
c_script = CSharpScript(x=panel)  # -> out, A; inputs x: String
# ---------- c_script: C# ----------
    if(x == "1")
    {
      A = true;
    }
    else
    {
      A = false;
    }
# ---------- c_script: C# additional code ----------
  string x = "0";
# ---------- end c_script ----------
c_script_2 = CSharpScript(reset=c_script.A)  # -> out, A; inputs reset: Boolean
# ---------- c_script_2: C# ----------
    if(reset)
    {
      if(n < 1)
      {
        n += 0.01;
      }
      else
      {
        n = 0;
      }
      A = n;
    }
    else
    {
      A = 0;
      n = 0;
    }
# ---------- c_script_2: C# additional code ----------
  double n = 0;
# ---------- end c_script_2 ----------
panel_2 = Panel(c_script_2.A)
graph = GraphMapper(
    c_script_2.A,
    x0=0,
    x1=1,
    y0=0,
    y1=1,
    amplitude=0.2536231875,
    container_name="Perlin",
    decay=0.3,
    frequency=0,
    x_offset=0.5,
    y_offset=0.5)
graph_2 = GraphMapper(c_script_2.A, x0=0, x1=1, y0=0, y1=1, container_name="Gaussian", factor=0.2, mean=0.5, sdev=0.1)
multiplication = Multiplication(A=graph, B=0.2)
multiplication_2 = Multiplication(A=graph_2, B=5)
multiplication_3 = Multiplication(A=multiplication_2, B=multiplication)
multiplication_4 = Multiplication(A=multiplication_3, B=Slider(100, range=0..100))
merge = Merge(
    Data1=multiplication_4,
    Data2=multiplication_4,
    Data3=multiplication_4,
    Data4=multiplication_4,
    Data5=multiplication_4,
    Data6=multiplication_4)
join = TextJoin(Text=merge, Join=";")
udp_sender = UDPSender(Data=join, IPAddressOfUDPServer="127.0.0.1", UDPPort=Slider(4444, range=0..10000))
panel_3 = Panel(join)
